# Dynamo graph 6D_Carbon_Footprin_3DPC.dyn "carbon" (Dynamo 2.13.1.3887)
# packages: bimorphNodes 5.1.3

# group: Schedules of quantities for material
all_elements_in_active_view = ElementsInView()
getCategory = Element.GetCategory(element=all_elements_in_active_view)
uniqueItems = List.UniqueItems(list=getCategory)
string_from_object = FromObject(object=uniqueItems)
code_block = CodeBlock { "Viewports"; }
indexOf = List.IndexOf(list=string_from_object, element=code_block)
removeItemAtIndex = List.RemoveItemAtIndex(list=string_from_object, indices=indexOf)
byName = Category.ByName(name=removeItemAtIndex)
string = StringInput("Schedule ")
add = string + uniqueItems
schedule_type = ScheduleTypes("MaterialTakeoff")
createSchedule = ScheduleView.CreateSchedule(category=byName, name=add, scheduleType=schedule_type)
schedulableFields = ScheduleView.SchedulableFields(scheduleView=createSchedule)
string_from_object_2 = FromObject(object=schedulableFields)
code_block_2 = CodeBlock { ["Material: Name","Material: Volume", "Material: Area"]; }
indexOf_2 = List.IndexOf(list=string_from_object_2, element=code_block_2, lacing=CrossProduct)
getItemAtIndex = List.GetItemAtIndex(list=schedulableFields, index=indexOf_2, lacing=Longest)
addFields = ScheduleView.AddFields(scheduleView=createSchedule, fields=getItemAtIndex)
fields = ScheduleView.Fields(scheduleView=addFields)

# group: Quantities for material
passTrought = Python(IN[0]=fields)  # CPython3
# ---------- passTrought.python (14 lines) ----------
# Load the Python Standard and DesignScript Libraries
import sys
import clr
clr.AddReference('ProtoGeometry')
from Autodesk.DesignScript.Geometry import *


trigger = IN[0]


if trigger:
    OUT = "Schedules"
else:
    OUT = None
# ----------------------------------------
byName_2 = Category.ByName(name=passTrought)
all_elements_of_category = ElementsOfCategory(Category=byName_2)
firstItem = List.FirstItem(list=all_elements_of_category)
code_block_3 = CodeBlock { 0; }
getDataColumns = Revit.Schedule.GetDataColumns(scheduleView=all_elements_of_category, columnIndexes=code_block_3)
flatten = List.Flatten(list=getDataColumns, lacing=Longest)
code_block_4 = CodeBlock { 0; }
removeItemAtIndex_2 = List.RemoveItemAtIndex(list=flatten, indices=code_block_4, lacing=Longest)
removeItemAtIndex_3 = List.RemoveItemAtIndex(list=removeItemAtIndex_2, indices=code_block_4, lacing=Longest)
uniqueItems_2 = List.UniqueItems(list=removeItemAtIndex_3, lacing=Longest)
python_script = Python(IN[0]=removeItemAtIndex_3, IN[1]=uniqueItems_2)  # CPython3
# ---------- python_script.python (14 lines) ----------
# Load the Python Standard and DesignScript Libraries
import sys
import clr
clr.AddReference('ProtoGeometry')
from Autodesk.DesignScript.Geometry import *

# The inputs to this node will be stored as a list in the IN variables.
sara = IN[0]
ana = IN[1]

def indices_por_valor(grande, pequeños):
    return [[i for i, x in enumerate(grande) if x == val] for val in pequeños]

OUT = [indices_por_valor(s, a) for s, a in zip(sara, ana)]
# ----------------------------------------
code_block_5 = CodeBlock { 1; }
getDataColumns_2 = Revit.Schedule.GetDataColumns(scheduleView=all_elements_of_category, columnIndexes=code_block_5)
flatten_2 = List.Flatten(list=getDataColumns_2, lacing=Longest)
code_block_6 = CodeBlock { 0; }
removeItemAtIndex_4 = List.RemoveItemAtIndex(list=flatten_2, indices=code_block_6, lacing=Longest)
removeItemAtIndex_5 = List.RemoveItemAtIndex(list=removeItemAtIndex_4, indices=code_block_6, lacing=Longest)
code_block_7 = CodeBlock { " "; }
split = String.Split(string=removeItemAtIndex_5, separator0=code_block_7)
toNumber = String.ToNumber(string=split)
isNull = Object.IsNull(object=toNumber)
filterByBoolMask = List.FilterByBoolMask(list=toNumber, mask=isNull)
flatten_3 = List.Flatten(list=filterByBoolMask.out, lacing=Longest)
python_script_2 = Python(IN[0]=python_script, IN[1]=flatten_3)  # CPython3
# ---------- python_script_2.python (37 lines) ----------
import sys
import clr
clr.AddReference('ProtoGeometry')
from Autodesk.DesignScript.Geometry import *

positions = IN[0][0]
quantities = IN[1][0]

results = []

for i in range(len(positions)):
    pos_group = positions[i]
    qty_list = quantities[i]

    summed_values = []

    # Asegurarse que qty_list es una lista
    if not isinstance(qty_list, list):
        results.append([0])  # o usar 'continue' o un mensaje de error
        continue

    # Asegurarse que pos_group es lista de listas o lista simple
    if isinstance(pos_group[0], list):
        # Caso: lista de listas
        for index_list in pos_group:
            values = [qty_list[j] for j in index_list if j < len(qty_list)]
            summed = sum(values)
            summed_values.append(summed)
    else:
        # Caso: lista simple de índices
        values = [qty_list[j] for j in pos_group if j < len(qty_list)]
        summed = sum(values)
        summed_values.append(summed)

    results.append(summed_values)

OUT = results
# ----------------------------------------
firstItem_2 = List.FirstItem(list=flatten_3, lacing=Longest)
firstItem_3 = List.FirstItem(list=python_script, lacing=Longest)
getItemAtIndex_2 = List.GetItemAtIndex(list=firstItem_2, index=firstItem_3, lacing=Longest)
python_script_3 = Python(IN[0]=python_script, IN[1]=flatten_3)  # CPython3
# ---------- python_script_3.python (35 lines) ----------
import sys
import clr
clr.AddReference('ProtoGeometry')
from Autodesk.DesignScript.Geometry import *

# Entrada
positions = IN[0][0]      # Aplanamos 1 nivel: [ [ [...], [...], ... ] ]
quantities = IN[1][0]     # Extraemos la única sublista útil

results = []

for i in range(len(positions)):
    pos_group = positions[i]
    qty_list = quantities[i]  # <––– CORREGIDO: ya accedemos directamente a la lista real

    summed_values = []

    # Verifica que qty_list es una lista válida
    if not isinstance(qty_list, list):
        results.append([0])
        continue

    if isinstance(pos_group[0], list):
        for index_list in pos_group:
            values = [qty_list[j] for j in index_list if j < len(qty_list)]
            summed = sum(values)
            summed_values.append(summed)
    else:
        values = [qty_list[j] for j in pos_group if j < len(qty_list)]
        summed = sum(values)
        summed_values.append(summed)

    results.append(summed_values)

OUT = summed
# ----------------------------------------
watch = Watch(python_script_3)
